# Dynamo graph dragos.milotin__2022-portfolio.dyn (Dynamo 2.3.2.15696)

code_block = CodeBlock()
# ---------- code_block.designscript (42 lines) ----------
/* This function will require a Dictionary from a JSON Object to work.
It also requires a Slider/Integer to get one item from a list of skills.
*/

def GetSkillsFilteredList (JSONdictionary, proficiency)
{


skillsList = Dictionary.ValueAtKey(JSONdictionary, "skills");
a = Dictionary.Keys(skillsList);
b = Dictionary.Values(skillsList);
c1 = Dictionary.ValueAtKey(b, "type");
c2 = Dictionary.ByKeysValues(a, c1);
c3 = Dictionary.Values(c2);
c4 = List.GroupByKey(a, c3);
c5 = Dictionary.ValueAtKey(c4, "unique keys");
c6 = Dictionary.ValueAtKey(c4, "groups");

d1 = Dictionary.ValueAtKey(b, "level");
d2 = Dictionary.ByKeysValues(a, d1);
d3 = Dictionary.Values(d2);
d4 = List.GroupByKey(a, d3);
d5 = Dictionary.ValueAtKey(d4, "unique keys") == proficiency;
d6 = Dictionary.ValueAtKey(d4, "groups");
d7 = List.FilterByBoolMask(d6, d5);
d8 = Dictionary.ValueAtKey(d7, "in");

e1 = List.AllIndicesOf(c6[0], d8);
e2 = String.Join(" | ", (List.Flatten(List.GetItemAtIndex(c6[0], e1))));

f1 = List.AllIndicesOf(c6[1], d8);
f2 = String.Join(" | ", (List.Flatten(List.GetItemAtIndex(c6[1], f1))));

k1 = c5[0] + " tools: " + e2;
k2 = c5[1] + " tools: " + f2;

k = [k1, k2];

statement = ((proficiency == "ninja")?"I have not yet reached ninja level yet :)":k);

return = statement;
};
# ----------------------------------------
code_block_2 = CodeBlock()
# ---------- code_block_2.designscript (21 lines) ----------
/* This function will require a Dictionary from a JSON Object to work.
It also requires a Slider/Integer to get one item from a list of activities.
*/

def GetActivityItem (JSONdictionary, ActivityItem)
{

activityList = Dictionary.ValueAtKey(JSONdictionary, "activity");
activityListComponents = Dictionary.Components(activityList);
activityListKeys = Dictionary.ValueAtKey(activityListComponents, "keys");
activityItem = List.GetItemAtIndex(activityListKeys, ActivityItem);
activityItemDetails = Dictionary.ValueAtKey(activityList, activityItem);
activityItemPeriod = Dictionary.ValueAtKey(activityItemDetails, "period");
activityItemDescription = Dictionary.ValueAtKey(activityItemDetails, "description");
activityItemURL = Dictionary.ValueAtKey(activityItemDetails, "url");
activityImageURL = Dictionary.ValueAtKey(activityItemDetails, "imageURL");

count = List.Count(activityListKeys);

return = [activityItem, activityItemPeriod, activityItemDescription, activityItemURL, activityImageURL];
};
# ----------------------------------------
code_block_3 = CodeBlock()
# ---------- code_block_3.designscript (12 lines) ----------
/* This function will require 3 pieces of text to
output a sentance describing my activity
*/

def FunctionSecondStatement(text0, text1, text2)
{

secondStatement = String.Join(" | ", [text0, text1, text2]);
comment = ["There are 5 items in my portfolio. Change Slider to view a different item below"];

return = ["=> PORTFOLIO:", comment, secondStatement];
};
# ----------------------------------------

# group: STEP 01
code_block_4 = CodeBlock()
# ---------- code_block_4.designscript (3 lines) ----------
/* Step 01: In order to keep the file readable I have used the `Code Block
Functions` feature to split the code into `Components`
*/;
# ----------------------------------------

# group: STEP 02
code_block_5 = CodeBlock()
# ---------- code_block_5.designscript (4 lines) ----------
/* Step 02: The review this dynamic portfolio user input is required in order to
view different sections. This section also coveres the `REST request` to a server
to get the portfolio data in JSON format
*/;
# ----------------------------------------

# group: STEP 04
code_block_6 = CodeBlock()
# ---------- code_block_6.designscript (3 lines) ----------
/* Step 04: This is a Code Block that processes the JSON file and retrieves
project data (text, imagest and URL);
*/;
# ----------------------------------------

# group: STEP 03
code_block_7 = CodeBlock()
# ---------- code_block_7.designscript (6 lines) ----------
/* Step 03.1: Please make sure that the `Preview` of the node bellow is
turned on to review its output
*/;
/* Step 03.2: This is the main Code Block that processes the JSON file taking
advantage of the structured data format this file format gives
*/;
# ----------------------------------------

# group: STEP 00
code_block_8 = CodeBlock()
# ---------- code_block_8.designscript (11 lines) ----------
/* Step 00: In order for this dynamic portfolio to work certain `dependecies`
are required:

=> `Python 2.7` needs to be installed in `Dynamo Core 2.0` folder such as:
	import sys
	sys.path.append(r'C:\Program Files (x86)\IronPython 2.7\Lib')

=> `JsonData Dynamo Package` by `alvpickmans` needs to be accesible in
`Dynamo Core 2.0`: https://github.com/alvpickmans/JsonData

*/;
# ----------------------------------------

# group: Toggle me!
what_to_see_something_cool = BoolSelector(false)

# group: DATA
get_json_from_server = Python()  # unwired: IN[0]
# ---------- get_json_from_server.python (24 lines) ----------
import sys
sys.path.append(r'C:\Program Files (x86)\IronPython 2.7\Lib')

import urllib
import urllib2
from urllib2 import Request

url = 'https://raw.githubusercontent.com/milotindragos/portfolio/main/data_portfolio.json'
values = {}

data = urllib.urlencode(values)
req = Request(url,data)  # as data is provided the method below will be a POST, NO data will have a method of GET

# START TESTS
has = req.has_data()
method = req.get_method()
# END TESTS

response = req.get_data()
#the_page = response.read()

f = urllib2.urlopen(url)

OUT = f.read()
# ----------------------------------------

# group: USER INPUT
rest_get_requests_change_slider = DoubleSlider(0, range=0..5 step 1)  # "REST GET Requests: Change slider to see activity items"

code_block_9 = CodeBlock(JSONserver=get_json_from_server, ActivityItem=rest_get_requests_change_slider)
# ---------- code_block_9.designscript (12 lines) ----------
// Copyright(c) 2022, Dragos Milotin
// @milotindragos

// Retrieve the JSON file and transform it into a Dictionary
JSON = Parse.String(JSONserver);
JSONdictionary = JsonObject.ToDictionary(JSON);

// Retrieve activity
act = GetActivityItem (JSONdictionary, ActivityItem);
statementActivityItem = [FunctionSecondStatement(act[0], act[1], act[2])];
act[3];
act[4];
# ----------------------------------------
code_block_10 = CodeBlock(message=code_block_9.statementActivityItem, imageURL=code_block_9.out5, portfolioItemURL=code_block_9.out4) { message[0][2]; imageURL; portfolioItemURL; }
full_page_portfolio = Python(IN[0]=what_to_see_something_cool, IN[1]=code_block_10.out0, IN[2]=code_block_10.imageURL, IN[3]=code_block_10.portfolioItemURL)
# ---------- full_page_portfolio.python (77 lines) ----------
# Copyright(c) 2020, Dragos Milotin
# @milotindragos, http://archi.tools

# START: DEFINE IMPORTS
import sys
sys.path.append(r'C:\Program Files (x86)\IronPython 2.7\Lib')

import urllib2
import webbrowser

import clr
clr.AddReference("System.Drawing")
from System.Drawing import Point, Size, Font, FontStyle
clr.AddReference("System.Windows.Forms")
from System.Windows.Forms import Application, Form, PictureBox, PictureBoxSizeMode, Label, Button, DialogResult
# END: DEFINE IMPORTS

# START: DEFINE INPUTS
boolean = IN[0]
message = IN[1]
imageURL = IN[2]
portfolioItemURL = IN[3]

# END: DEFINE INPUTS

# START: DEFINE CLASSES
class HelloWorldForm(Form):

    def __init__(self):
        self.Text = 'Hello World'
        self.Name = 'Hello World'
        self.Height = 1000
        self.Width = 800
        
        self.image = PictureBox()
        self.image.Location = Point(40, 40)
        self.image.Size = Size(700, 700)
        self.image.SizeMode = PictureBoxSizeMode.Zoom
        self.image.Load(imageURL)
        self.Controls.Add(self.image)
        
    	self.label = Label()
    	self.label.Text = message
    	self.label.Font = Font("Arial", 12,FontStyle.Bold)
        self.label.Location = Point(40, 850)
        self.label.MaximumSize = Size(700, 0)
        self.label.AutoSize = 1
        self.Controls.Add(self.label)
          
        self.button = Button()
    	self.button.Text = "Click button to view project details"
        self.button.DialogResult = DialogResult.OK
    	self.button.Font = Font("Arial", 11,FontStyle.Regular)
        self.button.Location = Point(40, 750)
        self.button.Height = 40
        self.button.Width = 700
        self.button.Click += self.buttonPressed
        self.Controls.Add(self.button)

        
    def buttonPressed(self, sender, args):
		url = portfolioItemURL
		html = webbrowser.open(url, new=2)
		self.Close()

form = HelloWorldForm()
# END: DEFINE CLASSES

# START: TEST FOR INPUT BY USER
if boolean == 1:
   Application.Run(form);
   text = "Click the button to see something interesting and close the form!";
else:
   text = "Waiting for user to say yes!";
# END: TEST FOR INPUT BY USER

OUT = text
# ----------------------------------------
watch = Watch(full_page_portfolio)

# group: STEP 05
code_block_11 = CodeBlock()
# ---------- code_block_11.designscript (5 lines) ----------
/* Step 05: This `Python Scipt` is used to
display the `Portfolio` in a more `graphical` way using `Win.Forms`

Do not forget to change the `Activity Items Slider` to get a new item
*/;
# ----------------------------------------

code_block_12 = CodeBlock(JSONserver=get_json_from_server)
# ---------- code_block_12.designscript (43 lines) ----------
// Copyright(c) 2022, Dragos Milotin
// @milotindragos

// Retrieve the JSON file and transform it into a Dictionary
JSON = Parse.String(JSONserver);
JSONdictionary = JsonObject.ToDictionary(JSON);

// Retrieve name
name = Dictionary.ValueAtKey(JSONdictionary, "name");
statementName = String.Join(" ", ["Hello, my name is", name]);

// Retrieve introduction
working = Dictionary.ValueAtKey(JSONdictionary, "working");
statementWork = String.Join(" ", ["I have been", working]);

// Retrieve this.description
thisDescription = Dictionary.ValueAtKey(JSONdictionary, "this");

// Retrieve certifications
certif = Dictionary.ValueAtKey(JSONdictionary, "certifications");
certifList = Dictionary.Values(certif);

// Retrieve skills
def f_skills(dict, proficiency){return GetSkillsFilteredList(dict, proficiency);
};

statementSkillsBeginner = f_skills(JSONdictionary, "beginner");
statementSkillsIntermediate = f_skills(JSONdictionary, "intermediate");
statementSkillsAdvanced = f_skills(JSONdictionary, "advanced");

// Final Presentation
def f_skills_card(title, skillLevel){return ["=> SKILLS:" + " @" + title + " level", skillLevel];
};

intro = ["=> INTRODUCTION:", statementName, statementWork, thisDescription];
skillsB = f_skills_card("Begginer", statementSkillsBeginner);
skillsI = f_skills_card("Intermediate", statementSkillsIntermediate);
skillsA = f_skills_card("Advanced", statementSkillsAdvanced);
certifications = List.Flatten(["=> CERTIFICATIONS:", List.Sort(certifList)]);
message = ["=> END:", "Thank you for taking the time to review my portfolio and I hope to hear from you soon"];

// Output Test Presentation
OUT = List.Flatten([intro, " ", skillsB, " ", skillsI, " ", skillsA, " ",certifications, " ", message]);
# ----------------------------------------
code_block_13 = CodeBlock { "<= Turn on preview (pin icon)!"; }
